# Dynamo graph CreateSpotElevationOnPipe.dyn "Add SpotElevations on Pipes" (Dynamo 2.0.2.6826)

# group: INFORMATION
# note: DynamoBIM version = 2.0
# PACKAGES:
# <Clockwork for Dynamo 2.3.0>
# NOTES:
# This definition creates spot elevations on an specific category [Pipes] at the highest point of the pipe for the active view

all_elements_in_active_view = ElementsInView()
getCategory = Element.GetCategory(element=all_elements_in_active_view)
string_from_object = FromObject(obj=getCategory)

# group: Category for element collection
categories = Categories(index=350)  # graph input

name = Category.Name(category=categories)
eq = string_from_object == name
filterByBoolMask = List.FilterByBoolMask(list=all_elements_in_active_view, mask=eq)
# note: Clockwork
location = Custom[Element.Location+](element=filterByBoolMask.in)  # Returns the location of an element as point, curve or curve loop, along with some booleans to help filtering the results. Unlike the OOTB Element.GetLocation node, it also retunrs sketch lines of sketch-based elements like floor slabs as well as the element's rotation property.
startPoint = Curve.StartPoint(curve=location.curves)
endPoint = Curve.EndPoint(curve=location.curves)

# group: Get highest point
python_script = Python(IN[0]=startPoint, IN[1]=endPoint)
# ---------- python_script.python (21 lines) ----------
# Enable Python support and load DesignScript library
import clr
clr.AddReference('ProtoGeometry')
from Autodesk.DesignScript.Geometry import *

# The inputs to this node will be stored as a list in the IN variables.
startPoint = IN[0]
endPoint = IN[1]

maxZ = []
maxPoint = []
# Place your code below this line
for i in range(len(startPoint)):
	if startPoint[i].Z >= endPoint[i].Z:
		maxZ.append(startPoint[i].Z)
		maxPoint.append(startPoint[i])
	else:
		maxZ.append(endPoint[i].Z)	
		maxPoint.append(endPoint[i])
# Assign your output to the OUT variable.
OUT = maxPoint
# ----------------------------------------

current = Document.Current()
activeView = Document.ActiveView(document=current)

# group: Spot Text location
code_block = CodeBlock { Vector.ByCoordinates(2,2); Vector.ByCoordinates(8,2); }
boolean = BoolSelector(true)

# group: Create Spot Elevation
# note: Clockwork
byPoint = Custom[SpotElevation.ByPoint](point=python_script, view=activeView, bend=code_block.out0, end=code_block.out1, hasLeader=boolean)  # Places a spot elevation at a given point in a given view. May not work in all view types.

watch = Watch(location.curves)
